# Grasshopper definition dot_print_tests_02_from_algo_10_slicer.ghx (Grasshopper 1.0.8)
# plug-ins: RhinoCodePluginGH

path = FilePath("C:\Users\mangliar\Documents\GitHub\bdm_voxel_builder\docs\algo_10_slicer\")
path_2 = FilePath("C:\Users\mangliar\Documents\GitHub\bdm_voxel_builder\temp\pointclouds\")

folder = Panel(path_2)
reload = Button()
import_and_sort_pts = IronPython2Script(folder=folder, nth=Slider(0, range=0..10), reset=reload)  # -> out, filename; inputs folder: String, nth: Int32, reset: Boolean
# ---------- import_and_sort_pts: IronPython ----------
import os
from compas.colors import Color
from compas.geometry import Pointcloud
import json
from ghpythonlib.treehelpers import list_to_tree

def get_nth_newest_file_in_folder(folder_path, n = 0):
    try:
        # Get a list of files in the folder
        files = [os.path.join(folder_path, filename) for filename in os.listdir(folder_path)]

        # Sort the files by change time (modification time) in descending order
        files.sort(key=lambda x: os.path.getmtime(x), reverse=True)

        # Return the newest file
        if files:
            return files[min(n, len(files))]
        else:
            print("Folder is empty.")
            return None
    except Exception as e:
        print(e)
        return None
if reset:
    pass

# params
Nth = nth
print(folder)
filename = get_nth_newest_file_in_folder(folder, Nth)
print(filename)
# ---------- end import_and_sort_pts ----------

path_3 = FilePath(import_and_sort_pts.filename)
panel = Panel(path_3)

# ---- group: specimen-1
path_4 = FilePath("C:\Users\mangliar\Documents\GitHub\bdm_voxel_builder\temp\pointclouds\2024-08-20_13_26_22_test_config_slice_b_i100a1_a1_i100_pointcloud.json")
panel_2 = Panel(path_4)

# ----
reload_2 = Button()

import_and_sort_pts_2 = IronPython2Script(filename=panel, reset=reload_2)  # -> out, pts, values, json_data; inputs filename: String, reset: Boolean
# ---------- import_and_sort_pts_2: IronPython ----------
import os
import json
from ghpythonlib.treehelpers import list_to_tree
from ghpythonlib.components import SortList

with open(filename, 'r') as f:
    json_data = json.load(f)

pointcloud = json_data['pointcloud']

pts = pointcloud['data']['points']
values = json_data['values']

values, pts = SortList(values, pts)
pts = list_to_tree(pts)
# ---------- end import_and_sort_pts_2 ----------
panel_3 = Panel(import_and_sort_pts_2.values)
panel_4 = Panel(import_and_sort_pts_2.pts)

dam = DataDam(DataA=import_and_sort_pts_2.pts, BufferDelay=10000000, BufferMode=2)
item = ListItem(List=dam, Index=0, Wrap=True)  # -> Item, Item1, Item2
pt = ConstructPoint(XCoordinate=item.Item, YCoordinate=item.Item1, ZCoordinate=item.Item2)  # -> flatten(Point)

number_slider = Slider(0.8, range=0..1)

# ----
# print board
panel_5 = Panel("600")
rectangle = Rectangle(Plane=PlaneXY(0, 0, 0), XSize=panel_5, YSize="800", Radius=0)  # -> Rectangle, Length
boundary = BoundarySurfaces(Edges=rectangle.Rectangle)

dot_distance = Slider(40, range=0..100)
layer_z = Slider(15, range=0..100)
move_object = Panel("0,100,18")

number_slider_2 = Slider(2.5, range=0..10)
number_slider_3 = Slider(0.25, range=0..1)
division = Division(A=dot_distance, B=number_slider_2)

pt_2 = Point(pt)
adjust_position_vector = Vector(move_object)
dot_distance_2 = Number(division)
layer_h = Number(layer_z)
scale_nu = ScaleNU(Geometry=pt_2, Plane=PlaneXY(0, 0, 0), ScaleX=dot_distance_2, ScaleY=dot_distance_2, ScaleZ=layer_h)  # -> Geometry, Transform
move = Move(Geometry=scale_nu.Geometry, Motion=adjust_position_vector)  # -> Geometry, Transform

pt_3 = Point(move.Geometry)
num = Number([18, 30, 40, 1.2, 8])
values_from_test_8 = Panel(num)

division_2 = Division(A="16", B=number_slider_2)

work_obj_origin_print_bed_offset = Slider(12, range=-100..100)
layer_count = Slider(3, range=0..10)

# ----
# TEST OBJECTIVES: 01: square dot block print: 3x5x4
# 
# PARAMETER tests
# 
# A: layer height / wait time
# 
# B: dot distance / speed
layer_height = Panel(layer_z)
speed = Panel("80")
dot_distance_3 = Panel(division)
wait_time = Panel("2.2")
merge = Merge(Data1=layer_height, Data2=dot_distance_3, Data3=speed, Data4=wait_time, Data5=work_obj_origin_print_bed_offset)

num_2 = Number(merge)

filename = Panel("dot_print_test_01")
values = Panel(num_2)
variables = Panel("""layer_height
dot_distance
speed
wait_time""")

variables_2 = Panel("""PUMP
0.5
FEEDER
15""")

send = Button()

variables_3 = Panel("""layer_height
dot_distance
speed
wait_time
bed_z_offset""")

# ---- group: test-7
num_3 = Number([18, 30, 40, 1, 8])
values_2 = Panel(num_3)
panel_6 = Panel("distance + 5")

# ---- group: test-1
num_4 = Number([8, 24, 5, 2])
values_3 = Panel(num_4)

# ---- group: test-4
num_5 = Number([20, 24, 40, 1, -6])
values_4 = Panel(num_5)

# ---- group: test-8
# perfect for solid block
# unit 30 mm
# wait_time +0.2
# 
# wait time at layers first *2
num_6 = Number([18, 30, 40, 1.2, 8])
values_5 = Panel(num_6)

# ---- group: test-2
num_7 = Number([12, 24, 25, 1])
values_6 = Panel(num_7)

# ---- group: test-5
# start on wet srf
num_8 = Number([18, 24, 40, 1, 4])
values_7 = Panel(num_8)

# ---- group: test-3
num_9 = Number([25, 24, 40, 1])
values_8 = Panel(num_9)

# ---- group: test-6
# perfect for solid block
# unit 24 mm
# first dot double wait_time
# fixed reverse in script
num_10 = Number([18, 24, 40, 1, 8])
values_9 = Panel(num_10)

# ---- group: test-9
# dot distance +4
# bed Z +4
num_11 = Number([18, 34, 40, 1.2, 12])
# print_bed_Z should be 75% of layer H
values_10 = Panel(num_11)

# ----
flatten = FlattenTree(Tree=pt_3, Path="{0}")

# ----
# check order
number_slider_4 = Slider(100, range=0..100)
split = SplitList(List=flatten, Index=number_slider_4)  # -> ListA, ListB
pt_4 = Point(split.ListA)
order = PointOrder(Points=pt_4)

# ----
# flip and orient planes
pt_5 = Point(flatten)
xy = XYPlane(Origin=pt_5)
pflip = FlipPlane(Plane=xy, ReverseX=False, ReverseY=False, SwapAxes=True)
rotate_plane = RotatePlane(Plane=pflip, Angle=degrees(Slider(-135, range=-180..180)))

pln = Plane(rotate_plane)
item_2 = ListItem(List=pln, Index=0, Wrap=True)  # -> Item1, Item
merge_2 = Merge(Data1=item_2.Item, Data2=item_2.Item1)

# ----
# approach planes
number_slider_5 = Slider(100, range=0..1000)
Z = UnitZ(Factor=number_slider_5)
move_2 = Move(Geometry=merge_2, Motion=Z)  # -> Geometry, Transform
bang = ExplodeTree(Data=graft(move_2.Geometry))  # -> flatten(Branch0), flatten(Branch1)

init_plane_count = Panel("2")
plane_per_layer = Panel()  # disabled
layer_count_2 = Number(layer_count)  # disabled
series = Series(Start=0, Step=plane_per_layer, Count=layer_count_2)  # disabled
addition = Addition(A=init_plane_count, B=series)
panel_7 = Panel(addition)

# ---- group: abb zone info compas rrc
python = GhPythonScript()  # -> out
# ---------- python: Python ----------
import compas_rrc as rrc
print("zone dict keys:\n",  rrc.Zone.__dict__.keys())
print('zone dict values:\n', rrc.Zone.__dict__.values())
# ---------- end python ----------

# ----
show_partially = Slider(1, range=0..1)
list = ValueList({"show voxel cubes": 0, "show as printed dots": 1, "show rotated voxel cubes": 2}, selected="show as printed dots")

lng = ListLength(List=panel_3)
multiplication = Multiplication(A=lng, B=show_partially)

point_count = Panel(lng)

# ---- group: remap color
split_2 = SplitList(List=panel_3, Index=multiplication)  # -> ListA, ListB
num_12 = Number(split_2.ListA)
bnd = Bounds(Numbers=num_12)
dedomain = DeconstructDomain(Domain=bnd)  # -> Start, End
division_3 = Division(A=dedomain.End, B=Slider(1000, range=0..1000))
dom = ConstructDomain(DomainStart=dedomain.Start, DomainEnd=division_3)
remap = RemapNumbers(Value=num_12, Source=bnd, Target="100 to 255")  # -> Mapped, Clipped
remap_2 = RemapNumbers(Value=remap.Mapped, Source="0 to 1", Target=Domain(0, 1))  # -> Mapped, Clipped
multiplication_2 = Multiplication(A=remap.Mapped, B=Slider(0.55, range=0..1))
multiplication_3 = Multiplication(A=remap.Mapped)
multiplication_4 = Multiplication(A=remap.Mapped)
rgb = ColourRGB(Alpha=255, Red=multiplication_2, Green=remap.Mapped, Blue=remap.Mapped)

# ----
split_3 = SplitList(List=move.Geometry, Index=multiplication)  # -> ListA, ListB
gate = StreamGate(Stream=split_3.ListA, Gate=list)  # -> Target0, Target1, Target2

subtraction = Subtraction(A=lng, B=Slider(8, range=0..10))
num_13 = Number(dot_distance_2)
num_14 = Number(layer_h)
division_4 = Division(A=num_14, B=2)

multiplication_5 = Multiplication(A=num_13, B=Slider(2.5, range=0..10))

division_5 = Division(A=multiplication_5, B=2)
multiplication_6 = Multiplication(A=Slider(1, range=0..10), B=division_5, C=Slider(2.5, range=0..10))

number_slider_6 = Slider(1, range=0..1)
box = CenterBox(Base=PlaneXY(0, 0, 0), X=division_5, Y=division_5, Z=division_4)
move_3 = Move(Motion=gate.Target0)  # -> Geometry, Transform
mbox = MeshBox(Base=box, XCount=number_slider_6, YCount=number_slider_6, ZCount=number_slider_6)
swatch = ColourSwatch(SwatchColor=RGBA(209, 96, 187, 237))
transform = Transform(Geometry=mbox, Transform=move_3.Transform)
preview = CustomPreview(Geometry=transform, Material=rgb)

cir = Circle(Plane=PlaneXY(0, 0, 0), Radius=multiplication_6)
transform_2 = Transform(Geometry=cir, Transform=gate.Target1)

xy_2 = XYPlane(Origin=Point(0, 0, 0))
number_slider_7 = Slider(1.4, range=0..10)
rotate = Rotate(Geometry=xy_2, Angle=degrees("45"), Plane=PlaneXY(0, 0, 0))  # -> Geometry, Transform
transform_3 = Transform(Geometry=mbox, Transform=rotate.Transform)
move_4 = Move(Motion=gate.Target2)  # -> Geometry, Transform
swatch_2 = ColourSwatch(SwatchColor=RGBA(255, 255, 255, 237))

number_slider_8 = Slider(0.2, range=0..1)
msphereex = MeshSphereEx(Base=PlaneXY(0, 0, 0), Radius=multiplication_6, Count=5)
scale_nu_2 = ScaleNU(Geometry=msphereex, Plane=PlaneXY(0, 0, 0), ScaleX=1, ScaleY=1, ScaleZ=number_slider_8)  # -> Geometry, Transform
transform_4 = Transform(Geometry=scale_nu_2.Geometry, Transform=gate.Target1)
swatch_3 = ColourSwatch(SwatchColor=RGBA(209, 198, 96, 237))

scale_nu_3 = ScaleNU(Plane=PlaneXY(0, 0, 0), ScaleX=number_slider_7, ScaleY=number_slider_7, ScaleZ=number_slider_8)  # -> Geometry, Transform
transform_5 = Transform(Geometry=transform_3, Transform=scale_nu_3.Transform)
transform_6 = Transform(Geometry=transform_5, Transform=move_4.Transform)
preview_2 = CustomPreview(Geometry=transform_6, Material=rgb)

scale_nu_4 = ScaleNU(Geometry=msphereex, Plane=PlaneXY(0, 0, 0), ScaleX=1, ScaleY=1, ScaleZ=Slider(2, range=0..10))  # -> Geometry, Transform
transform_7 = Transform(Geometry=transform_4, Transform=scale_nu_4.Transform)

preview_3 = CustomPreview(Geometry=transform_7, Material=rgb)

# ----
# travel planes
pdecon = Deconstruct(Point=merge_2)  # -> XComponent, YComponent, ZComponent
sort = SortList(Keys=pdecon.ZComponent)  # -> Keys, ValuesA
item_3 = ListItem(List=reverse(sort.Keys), Index=0, Wrap=True)
xy_3 = XYPlane(Origin=Point(0, 0, 0))

lift_travel_plane = Slider(100, range=0..100)

# ----
# dump fab data
panel_8 = Panel("150,-80,0")
pl_origin = PlaneOrigin(Base=merge_2, Origin=panel_8)
panel_9 = Panel(filename)
path_5 = FilePath("C:\Users\mangliar\Documents\GitHub\bdm_voxel_builder\data\live\fab_data\")
folder_2 = Panel(path_5)
panel_10 = Panel(python)

addition_2 = Addition(A=item_3, B=lift_travel_plane)
pl_offset = PlaneOffset(BasePlane=xy_3, Offset=addition_2)
project = Project(Geometry=pl_origin, Plane=pl_offset)  # -> Geometry, Transform
bang_2 = ExplodeTree(Data=graft(project.Geometry))  # -> Branch0, Branch1

merge_3 = Merge(
    Data1=flatten(bang_2.Branch0),
    Data2=flatten(bang.Branch0),
    Data3=flatten(pln),
    Data4=flatten(bang.Branch1),
    Data5=flatten(bang_2.Branch1))
order_2 = PointOrder(Points=merge_3)

pln_2 = Plane(merge_3)

# ----
# wait time
multiply_wait_time = Slider(1.4, range=0..10)
wait_time_2 = Panel(wait_time)
multiplication_7 = Multiplication(A=wait_time_2, B=multiply_wait_time)
panel_11 = Panel(wait_time_2)
panel_12 = Panel(multiplication_7)
long = LongestList(ListA=panel_11, ListB=pln_2, PaddingMode=2)  # -> ListA, ListB
replace = ReplaceItems(List=long.ListA, Item=panel_12, Indices=flatten(panel_7), Wrap=False)
wait_time_3 = Panel(replace)

panel_13 = Panel(speed)
long_2 = LongestList(ListA=panel_13, ListB=pln_2, PaddingMode=2)  # -> ListA, ListB

# ----
# speed
panel_14 = Panel("10")
panel_15 = Panel("""0
1""")
lng_2 = ListLength(List=long_2.ListA)
lng_3 = ListLength(List=long_2.ListA)
addition_3 = Addition(A=lng_2, B="-1")
addition_4 = Addition(A=lng_3, B="-2")
merge_4 = Merge(Data1=panel_15, Data2=addition_3)
merge_5 = Merge(Data1="2", Data2=addition_4)
replace_2 = ReplaceItems(List=long_2.ListA, Item="100", Indices=merge_4, Wrap=False)
replace_3 = ReplaceItems(List=replace_2, Item=panel_14, Indices=merge_5, Wrap=False)
speed_2 = Panel(replace_3)

# ----
# io 5 print
panel_16 = Panel("1")
long_3 = LongestList(ListA=panel_16, ListB=pln_2, PaddingMode=2)  # -> ListA, ListB
panel_17 = Panel("""0
1""")

lng_4 = ListLength(List=long_3.ListA)
addition_5 = Addition(A=lng_4, B="-1")
replace_4 = ReplaceItems(List=long_3.ListA, Item="0", Indices=[addition_5, panel_17], Wrap=False)

printio = Panel(replace_4)

# ----
# io 6 direction
panel_18 = Panel("0")
long_4 = LongestList(ListA=panel_18, ListB=pln_2, PaddingMode=2)  # -> ListA, ListB

panel_19 = Panel("""-3
-2""")
lng_5 = ListLength(List=long_4.ListA)
addition_6 = Addition(A=lng_5, B=panel_19)
replace_5 = ReplaceItems(List=long_4.ListA, Item="1", Indices=addition_6, Wrap=False)

dir_io = Panel(replace_5)

# ----
# design input
zone = Panel("5")
speed_3 = Panel(replace_3)
dir_io_2 = Panel(replace_5)
tool_name = Panel("t_erratic")
wobj_name = Panel("wobj_bhg")
pln_3 = Plane(merge_3)
move_l = Panel("True")
printio_2 = Panel(replace_4)
wait_time_4 = Panel(replace)

python_2 = GhPythonScript(
    planes=pln_3,
    movel=move_l,
    print_IO=printio_2,
    dir_IO=dir_io_2,
    tool_name=tool_name,
    wobj_name=wobj_name,
    speed=speed_3,
    wait_time=wait_time_4,
    zone=zone,
    dump=send,
    folder=path_5,
    filename=panel_9)  # -> out; inputs planes: list of Plane, movel: Boolean, print_IO: list of Int32, dir_IO: list of Int32, speed: list, wait_time: list, zone: Int32, dump: Boolean
# ---------- python_2: Python ----------
"""
component inputs:
dumps simple print fab data
planes: list = None,
print_IO: int | list = 0,
speed: int | list = 100,
zone: str | int | list = "fine",
movel: bool | list = False,"""

import json
import os

from compas_rhino.conversions import plane_to_compas_frame
from compas.data import json_dump


def wrap_fab_data(
    frames = None,
    print_IO = 0,
    dir_IO = 0,
    speed = 100,
    wait_time = 2,
    zone = "Z50",
    movel = False
):
    data = {}
    data["frames"] = frames
    data["print_IO"] = print_IO
    data["dir_IO"] = dir_IO
    data["speed"] = speed
    data["zone"] = zone
    data["movel"] = movel
    data['wait_time'] = wait_time
    return data


frames = []
for plane in planes:
    frames.append(plane_to_compas_frame(plane))

data = wrap_fab_data(frames, print_IO, dir_IO, speed, wait_time, zone, movel)

filename += '.json'
file = os.path.join(folder, filename)
if dump:
    json_dump(data, file)
    print('fab data saved: ', file)
# ---------- end python_2 ----------
panel_20 = Panel(python_2)
