# Grasshopper definition load_fabplanes_from_file.ghx (Grasshopper 1.0.8)
# plug-ins: RhinoCodePluginGH

path = FilePath("C:\Users\mangliar\Documents\GitHub\bdm_voxel_builder\temp\fabplanes\2024-09-17_16_01_18_algo_20_fabplanes.txt")
panel = Panel(path)
ipy2 = IronPython2Script(path=path)  # -> out, planes; inputs path: String
# ---------- ipy2: IronPython ----------
"""load fabplanes from file"""

from compas import json_loads
from compas_rhino.conversions import plane_to_rhino
from compas.geometry import Plane

with open(path, "r") as f:
    # data = f.readlines()
    data = f.read()
    lines = data.split('\n')[:-1]
    print(lines[0])
    planes = []
    for line in lines:
        plane = line
        planes.append(plane)
        

# rhino_planes = []
# for plane in planes:
#     rhino_plane = plane_to_rhino(plane)
#     rhino_planes.append(rhino_plane)
# ---------- end ipy2 ----------
ipy2_2 = IronPython2Script(planes=ipy2.planes)  # -> out, rhino_planes; inputs planes: list
# ---------- ipy2_2: IronPython ----------
"""load fabplanes from file"""

from compas import json_loads
from compas_rhino.conversions import plane_to_rhino
from compas.geometry import Plane
# plane = planes[0]
# for plane in planes:
#     print(type(plane))

#     a = json_loads(plane)
compas_planes = [json_loads(data) for data in planes]
rhino_planes = [plane_to_rhino(plane) for plane in compas_planes]

# a = plane_to_rhino(planes[0])
# ---------- end ipy2_2 ----------
panel_2 = Panel(ipy2_2.rhino_planes)
pln = Plane(ipy2_2.rhino_planes)

lng = ListLength(List=ipy2.planes)
panel_3 = Panel(lng)

# ---- group: subd bullet
pl_offset = PlaneOffset(
    BasePlane=PlaneXY(0, 0, 0),
    Offset=[Slider(0, range=0..10), Slider(0, range=0..10), Slider(3, range=0..10), Slider(3, range=0..10)])
polygon = Polygon(
    Plane=pl_offset,
    Radius=[Slider(2, range=0..10), Slider(3, range=0..10), Slider(3, range=0..10), Slider(2, range=0..10)],
    Segments=Slider(8, range=0..10),
    FilletRadius=0)  # -> Polygon, Length
loft = Loft(Curves=polygon.Polygon, Options={Adjust=False, Closed=False, LoftEnds=0, LoftSimp=0, LoftType=3, Rebuild=10, Refit=0.01})
cap = CapHoles(Brep=loft)
mesh = MeshBrep(
    Brep=cap,
    Settings={GridMaxCount=0, GridMinCount=16, JaggedSeams=False, MaxEdgeLength=0, MinEdgeLength=0.0001, MinTolerance=0, Refine=True, RefineAngle=0, RelativeTolerance=0.65, SimplePlanes=True, Tolerance=0})
subdmesh = SubDFromMesh(Mesh=mesh, Creases=1, Corners=1, Interpolate=False)
meshsubd = MeshFromSubD(SubD=subdmesh, Density=Slider(1, range=0..1))

# ----
range = Range(Domain=Domain(0, 1), Steps=10)

number_slider = Slider(1, range=0..10)  # disabled
xy = XYPlane(Origin=Point(0, 0, 0))  # disabled
number_slider_2 = Slider(3, range=0..10)  # disabled
number_slider_3 = Slider(3, range=0..10)  # disabled
pflip = FlipPlane(Plane=xy, ReverseX=False, ReverseY=False, SwapAxes=True)  # disabled
neg = Negative(Value=number_slider)  # disabled
pl_offset_2 = PlaneOffset(BasePlane=pflip, Offset=neg)  # disabled
cyl = Cylinder(Base=pl_offset_2, Radius=number_slider_2, Length=number_slider_3)  # disabled
cap_2 = CapHoles(Brep=cyl)  # disabled

X = UnitX(Factor=1)
orient = Orient(Source=PlaneXY(0, 0, 0), Target=pln)  # -> Geometry, Transform; disabled

lng_2 = ListLength(List=pln)
split = SplitList(List=pln, Index=Slider(650, range=0..2300))  # -> ListA, ListB
multiplication = Multiplication(A=lng_2, B=Slider(0.821, range=0..1))
geo = Geometry(split.ListA)
orient_2 = Orient(Source=PlaneXY(0, 0, 0), Target=geo)  # -> Geometry, Transform

align = AlignPlane(Plane=pln, Direction=X)  # -> Plane, Angle
neg_2 = Negative(Value=Slider(80, range=0..100))
cyl_2 = Cylinder(Base=PlaneXY(0, 0, 0), Radius=Slider(4, range=0..10), Length=neg_2)
item = ListItem(List=reverse(orient_2.Transform), Index=0, Wrap=True)
transform = Transform(Geometry=cyl_2, Transform=item)
preview = CustomPreview(
    Geometry=transform,
    Material={diffuse=RGB(221, 160, 221), emission=RGB(66, 48, 66), shine=0.5, specular=RGB(255, 255, 255), transparency=0})
transform_2 = Transform(Geometry=meshsubd, Transform=orient_2.Transform)
preview_2 = CustomPreview(
    Geometry=transform_2,
    Material={diffuse=RGB(221, 160, 221), emission=RGB(66, 48, 66), shine=0.5, specular=RGB(255, 255, 255), transparency=0})
